# Dynamo graph CreateCSV.dyn (Dynamo 2.17.0.3472)

# group: Speicherort + Name
# Erstellt einen Pfad in welchem die CSV Datei gespeichert wird.
zielordner = Directory("C:\Users\lukas.bernegger\Desktop\Testzeichnung")
dateiname = StringInput("Material")

# group: Pfad erstellen
# Hier keine Änderungen vornehmen.
generate_path = CodeBlock(destinationPath=zielordner, name=dateiname) { destinationPath; name; fileName = destinationPath + "\\" + name + ".csv"; }
watch = Watch(generate_path.fileName)

# group: Elemente Auswählen
# Drücke auf Ändern und wähle dann im Modell die Profile aus
selectAdvanceSteelObjects = ASObjectSelection()  # 3 picked in the model

# group: Filter Funktion
# Filtert die Objekte nach Träger und Bleche (Hier keine Änderungen vornehmen)
alle_elemente = Watch(selectAdvanceSteelObjects)
python_script_object_filter = Python(IN[0]=alle_elemente)  # CPython3
# ---------- python_script_object_filter.python (28 lines) ----------
# Phython-Standard- und DesignScript-Bibliotheken laden
import sys
import clr
clr.AddReference('ProtoGeometry')
from Autodesk.DesignScript.Geometry import *

# Initialisieren
steelObjects = IN[0]

straightBeamObjects = []
plateObjects = []
otherObjects = []

# Filtern in 2 Listen
for object in steelObjects:
    name = str(object)
    if name == "StraightBeam":
        straightBeamObjects.append(object)
    elif name == "Plate":
        plateObjects.append(object)
    else:
        otherObjects.append(object)


# Weisen Sie Ihre Ausgabe der OUT-Variablen zu.
OUT = [straightBeamObjects,
       plateObjects,
       otherObjects]
# ----------------------------------------
code_block = CodeBlock(filteredObjects=python_script_object_filter)
# ---------- code_block.designscript (7 lines) ----------
filteredObjects;

// Gerade Träger (StraightBeam)
List.GetItemAtIndex(filteredObjects,0);

// Bleche (Plate)
List.GetItemAtIndex(filteredObjects,1);
# ----------------------------------------
träger = Watch(code_block.out1)
bleche = Watch(code_block.out2)

# group: Träger Information ermitteln
# Hier keine Änderungen vornehmen!
getObjectProperties = AdvanceSteel.Nodes.Property.GetObjectProperties(steelObject=träger)
profileigenschaften_liste = Watch(getObjectProperties)
getLength = AdvanceSteel.Nodes.Util.Beam.GetLength(steelObject=träger)
code_block_length = CodeBlock(beamLength=getLength) { beamLength; Math.Round(beamLength,2); }
längen = Watch(code_block_length.out1)
getBeamSawInformation = AdvanceSteel.Nodes.Util.Beam.GetBeamSawInformation(steelObject=träger)
code_block_angle = CodeBlock(FlangeAngleAtStart=getBeamSawInformation.FlangeAngleAtStart, WebAngleAtStart=getBeamSawInformation.WebAngleAtStart, FlangeAngleAtEnd=getBeamSawInformation.FlangeAngleAtEnd, WebAngleAtEnd=getBeamSawInformation.WebAngleAtEnd)
# ---------- code_block_angle.designscript (20 lines) ----------
// Winkelschnitte Start Profil
FlangeAngleAtStart;
WebAngleAtStart;

// Winkelschnitte Ende Profil
FlangeAngleAtEnd;
WebAngleAtEnd;

// Winkelberechnungen
constant = 4.84813681109311e-05;

StartFlangeAngle = FlangeAngleAtStart / constant;
StartWebAngle = WebAngleAtStart / constant;
EndFlangeAngle = FlangeAngleAtEnd / constant;
EndWebAngle = WebAngleAtEnd / constant;

Math.Round(StartFlangeAngle, 2);
Math.Round(StartWebAngle, 2);
Math.Round(EndFlangeAngle, 2);
Math.Round(EndWebAngle, 2);
# ----------------------------------------
start_winkel_flansch = Watch(code_block_angle.out9)
start_winkel_steg = Watch(code_block_angle.out10)
ende_winkel_flansch = Watch(code_block_angle.out11)
ende_winkel_steg = Watch(code_block_angle.out12)

# group: CSV Datei mit Einträgen erstellen
# Hier keine Änderungen vornehmen
python_script = Python(IN[0]=profileigenschaften_liste, IN[1]=längen, IN[2]=start_winkel_flansch, IN[3]=start_winkel_steg, IN[4]=ende_winkel_flansch, IN[5]=ende_winkel_steg)  # CPython3
# ---------- python_script.python (84 lines) ----------
# Phython-Standard- und DesignScript-Bibliotheken laden
import sys
import clr
clr.AddReference('ProtoGeometry')
from Autodesk.DesignScript.Geometry import *

# Initialisieren
steelObjectPropertys = IN[0]
beamLength = IN[1]
startFlangeAngle = IN[2]
startWebAngle = IN[3]
endFlangeAngle = IN[4]
endWebAngle = IN[5]

objectPropertyList = []
objectPropertyListCSV = []

# Funktionen
def getValue(property):  # Filtert den Wert aus einem String
    property = property.split(" = ")
    propertyName = property[0]
    property = property[1]
    
    # Positionsnummer in eine Zahl umzuwandeln.
    if propertyName == "SinglePartNumber":
        property = int(property)
    
    return property

def convertToCsvFormat(tuple):
    tuple = str(tuple)
    string = tuple.replace(", ", ";").replace("'", "").replace("(", "").replace(")", "")
    
    return string

def checkOcurrences(propertyList, posNum):  # Zur Prüfung ob Teilenummer bereits vorhanden.
    
    return None
       

# Erstellt aus der kompletten Eigenschaftenliste eine neue Liste mit nur den benötigten Eigenschaften.
for objectIndex in range(0, len(steelObjectPropertys)):
    """
    Profileigenschaften können hier beliebig erweitert übernommen werden und müssen
    dann nur noch bei ObjectPropertieList in der gewünschten Reihenfolge angehängt werden.
    Index 4 = Name
    Index 32 = Material
    Index 50 = Einzelteilnummer
    """
    
    profileName = str(steelObjectPropertys[objectIndex][4])
    profileMaterial = str(steelObjectPropertys[objectIndex][32])
    profileSinglePartNumber = str(steelObjectPropertys[objectIndex][50])
    
    # Filtert den Wert aus dem String
    profileName = getValue(profileName)
    profileMaterial = getValue(profileMaterial)
    profileSinglePartNumber = getValue(profileSinglePartNumber)
    
    # Prüfe ob Einzelteilnummber bereits vorhanden.
    
    temp = checkOcurrences(objectPropertyList, profileSinglePartNumber) #### Funktion noch nicht fertig ####
    
    entry = (profileSinglePartNumber, 
             profileName, 
             profileMaterial, 
             beamLength[objectIndex],
             startFlangeAngle[objectIndex],
             startWebAngle[objectIndex],
             endFlangeAngle[objectIndex],
             endWebAngle[objectIndex])
            
    objectPropertyList.append(entry)

# In String mit ; Trennzeichen umwandeln
for item in objectPropertyList:
    item = convertToCsvFormat(item)
    objectPropertyListCSV.append(item)


# Ausgabe über die OUT Variable.
#OUT = objectPropertyListCSV

OUT = temp  # Für Temporärausgabe zur Überprüfng von Werten.
# ----------------------------------------
watch_2 = Watch(python_script)
exportCSV = Data.ExportCSV(filePath=watch, data=watch_2)

getPhysicalLengthAndWidth = AdvanceSteel.Nodes.Plates.Plate.GetPhysicalLengthAndWidth(steelObject=bleche)
getQuantityInModel = AdvanceSteel.Nodes.Util.SteelObject.GetQuantityInModel(steelObject=bleche)
watch_3 = Watch(getQuantityInModel)
